# Grasshopper definition modelv3.gh (Grasshopper 1.0.7)

panel = Panel("""{10,10,0}
{-10,10,0}
{-10,-10,0}
{10,-10,0}""")
number_slider = Slider(15, range=0..20)
limit_in_degrees = Slider(45, range=45..90)
theta = Slider(2.726, range=0..10)
R = Slider(97.62, range=0..500)
phi = Slider(0.703, range=0..10)

phi_2 = Slider(0, range=0..360, expression="(x*pi/180)")
theta_2 = Slider(0, range=-90..90, expression="(x*pi/180)")
R_2 = Slider(10, range=0..20)
phi_3 = Slider(90.125, range=0..360, expression="(x*pi/180)")
theta_3 = Slider(-82.262, range=-90..90, expression="(x*pi/180)")
R_3 = Slider(10, range=0..20)
phi_4 = Slider(70.227, range=0..360, expression="(x*pi/180)")
theta_4 = Slider(81.341, range=-90..90, expression="(x*pi/180)")
R_4 = Slider(10, range=0..20)
phi_5 = Slider(184.169, range=0..360, expression="(x*pi/180)")
theta_5 = Slider(-65.681, range=-90..90, expression="(x*pi/180)")
R_5 = Slider(10, range=0..20)
phi_6 = Slider(79.088, range=0..360, expression="(x*pi/180)")
theta_6 = Slider(-90, range=-90..90, expression="(x*pi/180)")
expression = Expression(x=R_2, y=theta_2, Expression="(x*cos(y))")
expression_2 = Expression(x=R_5, y=theta_2, Expression="(x*cos(y))")
expression_3 = Expression(x=R_4, y=theta_2, Expression="(x*cos(y))")
pt = Point(Point(0, 0, 0))
expression_4 = Expression(x=R_3, y=theta_2, Expression="(x*cos(y))")
expression_5 = Expression(x=R_2, y=theta_2, z=phi_2, Expression="(x*cos(z)*sin(y))")
expression_6 = Expression(x=R_2, y=theta_2, z=phi_2, Expression="(x*sin(y)*sin(z))")
expression_7 = Expression(x=R_5, y=theta_2, z=phi_2, Expression="(x*cos(z)*sin(y))")
expression_8 = Expression(x=R_5, y=theta_2, z=phi_2, Expression="(x*sin(y)*sin(z))")
expression_9 = Expression(x=R_4, y=theta_2, z=phi_2, Expression="(x*cos(z)*sin(y))")
expression_10 = Expression(x=R_4, y=theta_2, z=phi_2, Expression="(x*sin(y)*sin(z))")
expression_11 = Expression(x=R_3, y=theta_2, z=phi_2, Expression="(x*cos(z)*sin(y))")
expression_12 = Expression(x=R_3, y=theta_2, z=phi_2, Expression="(x*sin(y)*sin(z))")
move = Move(Geometry=pt, Motion=Vector(-5, -5, 0))  # -> Geometry, Transform
move_2 = Move(Geometry=pt, Motion=Vector(-5, 5, 0))  # -> Geometry, Transform
move_3 = Move(Geometry=pt, Motion=Vector(5, 5, 0))  # -> Geometry, Transform
move_4 = Move(Geometry=pt, Motion=Vector(5, -5, 0))  # -> Geometry, Transform
vec = VectorXYZ(XComponent=expression_5, YComponent=expression_6, ZComponent=expression)  # -> Vector, Length
vec_2 = VectorXYZ(XComponent=expression_7, YComponent=expression_8, ZComponent=expression_2)  # -> Vector, Length
vec_3 = VectorXYZ(XComponent=expression_9, YComponent=expression_10, ZComponent=expression_3)  # -> Vector, Length
vec_4 = VectorXYZ(XComponent=expression_11, YComponent=expression_12, ZComponent=expression_4)  # -> Vector, Length
move_5 = Move(Geometry=move.Geometry, Motion=vec.Vector)  # -> Geometry, Transform
move_6 = Move(Geometry=move_4.Geometry, Motion=vec_2.Vector)  # -> Geometry, Transform
move_7 = Move(Geometry=move_3.Geometry, Motion=vec_3.Vector)  # -> Geometry, Transform
move_8 = Move(Geometry=move_2.Geometry, Motion=vec_4.Vector)  # -> Geometry, Transform
srf4pt = _4PointSurface(CornerA=move_5.Geometry, CornerB=move_8.Geometry, CornerC=move_7.Geometry, CornerD=move_6.Geometry)  # disabled

rectangle = Rectangle(Plane=PlaneXY(0, 0, 0), XSize=Domain(-1, 1), YSize=Domain(-1, 1), Radius=0)  # -> Rectangle, Length
boxrec = BoxRectangle(Rectangle=rectangle.Rectangle, Height=Slider(20, range=0..50))
debrep = DeconstructBrep(Brep=boxrec)  # -> Faces, Edges, Vertices
split = SplitList(List=debrep.Vertices, Index=4)  # -> ListA, ListB
ma = MassAddition(Input=split.ListB)  # -> Result, PartialResults
division = Division(A=ma.Result, B="4")
rectangle_2 = Rectangle(Plane=division, XSize=Domain(-2, 2), YSize=Domain(-2, 2), Radius=0)  # -> Rectangle, Length
boxrec_2 = BoxRectangle(Rectangle=rectangle_2.Rectangle, Height=Domain(0, 1))
pdecon = Deconstruct(Point=division)  # -> XComponent, YComponent, ZComponent
addition = Addition(A=pdecon.XComponent, B=Slider(0, range=-8..8))
dom = ConstructDomain(DomainStart=number_slider, DomainEnd=expr("(x*-1)", number_slider))
pt_2 = ConstructPoint(XCoordinate=addition, YCoordinate=pdecon.YComponent, ZCoordinate=pdecon.ZComponent)
dom_2 = ConstructDomain(DomainStart="-3", DomainEnd="3")
rectangle_3 = Rectangle(Plane=pt_2, XSize=dom, YSize=dom_2, Radius=0)  # -> Rectangle, Length
boxrec_3 = BoxRectangle(Rectangle=rectangle_3.Rectangle, Height=Domain(1, 1.5))
debrep_2 = DeconstructBrep(Brep=boxrec_3)  # -> Faces, Edges, Vertices
split_2 = SplitList(List=debrep_2.Vertices, Index=4)  # -> ListA, ListB
dom_3 = ConstructDomain(DomainStart=number_slider, DomainEnd=expr("(x*-1)", number_slider))
dom_4 = ConstructDomain(DomainStart="-3", DomainEnd="3")
ma_2 = MassAddition(Input=split_2.ListB)  # -> Result, PartialResults
dom_5 = ConstructDomain(DomainStart=number_slider, DomainEnd=expr("(x*-1)", number_slider))
division_2 = Division(A=ma_2.Result, B="4")
pdecon_2 = Deconstruct(Point=division_2)  # -> XComponent, YComponent, ZComponent
addition_2 = Addition(A=pdecon_2.YComponent, B=Slider(0, range=-8..8))
pt_3 = ConstructPoint(XCoordinate=pdecon_2.XComponent, YCoordinate=addition_2, ZCoordinate=pdecon_2.ZComponent)
rectangle_4 = Rectangle(Plane=pt_3, XSize=dom_4, YSize=dom_3, Radius=0)  # -> Rectangle, Length
boxrec_4 = BoxRectangle(Rectangle=rectangle_4.Rectangle, Height=Domain(0, 0.5))
debrep_3 = DeconstructBrep(Brep=boxrec_4)  # -> Faces, Edges, Vertices
split_3 = SplitList(List=debrep_3.Vertices, Index=4)  # -> ListA, ListB
ma_3 = MassAddition(Input=split_3.ListB)  # -> Result, PartialResults
division_3 = Division(A=ma_3.Result, B="4")
rectangle_5 = Rectangle(Plane=division_3, XSize=dom_5, YSize=dom_5, Radius=0)  # -> Rectangle, Length
boxrec_5 = BoxRectangle(Rectangle=rectangle_5.Rectangle, Height=Domain(0, 0.5))
debrep_4 = DeconstructBrep(Brep=boxrec_5)  # -> Faces, Edges, Vertices
split_4 = SplitList(List=debrep_4.Vertices, Index=4)  # -> ListA, ListB
conmesh = ConstructMesh(Vertices=split_4.ListA, Faces={A=0, B=1, C=2, D=3})

# ----
# NOTE THAT !
# 6 DOF - 6 ACTUATORS NEEDED
# 4 ONLY SHOWN FOR LIMITS
conmesh_2 = ConstructMesh(Vertices=panel, Faces={A=0, B=1, C=2, D=3})  # disabled
rotax = RotateAxis(Geometry=conmesh_2, Angle=Slider(0, range=-3.141..3.141), Axis=Line((0, 0, 0), (0, 10, 0)))  # -> Geometry, Transform; disabled
rotax_2 = RotateAxis(Geometry=rotax.Geometry, Angle=Slider(0, range=-3.141..3.141), Axis=Line((0, 0, 0), (10, 0, 0)))  # -> Geometry, Transform; disabled
rotax_3 = RotateAxis(Geometry=rotax_2.Geometry, Angle=Slider(0, range=-3.141..3.141), Axis=Line((0, 0, 0), (0, 0, 10)))  # -> Geometry, Transform; disabled
vec_5 = VectorXYZ(XComponent=Slider(0, range=-40..40), YComponent=Slider(0, range=-40..40), ZComponent=Slider(20, range=0..50))  # -> Vector, Length; disabled
scale = Scale(Geometry=rotax_3.Geometry, Center=Point(0, 0, 0), Factor=Slider(1, range=0..2))  # -> Geometry, Transform; disabled
panel_2 = Panel("""{10,10,0}
{-10,10,0}
{-10,-10,0}
{10,-10,0}""")  # disabled
number_slider_2 = Slider(10, range=0..100)  # disabled
number_slider_3 = Slider(40, range=0..100)  # disabled
panel_3 = Panel("""{10,10,0}
{-10,10,0}
{-10,-10,0}
{10,-10,0}""")  # disabled
number_slider_4 = Slider(34, range=0..100)  # disabled
move_9 = Move(Geometry=scale.Geometry, Motion=vec_5.Vector)  # -> Geometry, Transform; disabled
mesh = Mesh(<mesh referenced from the Rhino model>)  # disabled
demesh = DeconstructMesh(Mesh=mesh)  # -> Vertices, Faces, Colours, Normals; disabled
ln = Line(StartPoint=panel_2, EndPoint=demesh.Vertices)  # disabled
divdist = DivideDistance(Curve=ln, Distance=number_slider_2)  # -> Points, Tangents, Parameters; disabled
len = Length(Curve=ln)  # disabled
len_2 = Length(Curve=ln)  # disabled
end = EndPoints(Curve=ln)  # -> Start, End; disabled
vec2pt = Vector2Pt(PointA=end.Start, PointB=end.End, Unitize=False)  # -> Vector, Length; disabled
eval = Evaluate(F="If(x>y, y, x)", x=len, y=number_slider_3)  # disabled
eval_2 = Evaluate(F="If(x>12, 12, 12)", x=len_2)  # disabled
item = ListItem(List=divdist.Points, Index=0, Wrap=True)  # disabled
item_2 = ListItem(List=divdist.Points, Index=1, Wrap=True)  # disabled
pl = PlaneNormal(Origin=panel_3, ZAxis=vec2pt.Vector)  # disabled
ln_2 = Line(StartPoint=item, EndPoint=item_2)  # disabled
pipe = Pipe(Curve=ln_2, Radius=1, Caps=1)  # disabled
cyl = Cylinder(Base=pl, Radius=0.5, Length=eval)  # disabled
cyl_2 = Cylinder(Base=pl, Radius=1, Length=eval_2)  # disabled
divdist_2 = DivideDistance(Curve=ln, Distance=number_slider_4)  # -> Points, Tangents, Parameters; disabled
item_3 = ListItem(List=divdist_2.Points, Index=0, Wrap=True)  # disabled
item_4 = ListItem(List=divdist_2.Points, Index=1, Wrap=True)  # disabled
ln_3 = Line(StartPoint=item_3, EndPoint=item_4)  # disabled
pipe_2 = Pipe(Curve=ln_3, Radius=0.4, Caps=1)  # disabled
pipe_3 = Pipe(Curve=ln, Radius=0.4, Caps=1)  # disabled

line = LineSDL(Start=Point(0, 0, 0), Direction=Vector(0, 0, 1), Length=1)
xz = XZPlane(Origin=Point(0, 0, 0))
arc = Arc(Plane=xz, Radius=R, Angle=Domain(0, 1.570796327))  # -> Arc, Length
material = CreateMaterial(Diffuse=RGB(117, 214, 255), Specular=RGB(255, 255, 255), Emission=RGB(13, 49, 54), Transparency=0.8, Shine=1)
revsrf = Revolution(Curve=arc.Arc, Axis=line, Domain=Domain(0, 6.283185307))

# ----
# SUN POSITION W/ LIMITS
# SUN
# check if it is circle
subtraction = Subtraction(A=180, B=limit_in_degrees)
deg = Degrees(Radians=theta)
sph = Sphere(Base=PlaneXY(0, 0, 0), Radius=R)
expression_13 = Expression(x=limit_in_degrees, y=deg, Expression="If(y<x, x, y)")
expression_14 = Expression(x=subtraction, y=expression_13, Expression="If(y>x, x, y)")
rad = Radians(Degrees=expression_14)
expression_15 = Expression(x=R, y=rad, Expression="(x*cos(y))")
expression_16 = Expression(x=R, y=rad, Expression="(x*sin(y))")
preview = CustomPreview(Geometry=revsrf, Material=material)
vec_6 = VectorXYZ(XComponent=0, YComponent=expression_15, ZComponent=expression_16)  # -> Vector, Length
rot3d = Rotate3D(Geometry=vec_6.Vector, Angle=phi, Center=Point(0, 0, 0), Axis=Vector(0, 0, 1))  # -> Geometry, Transform
ln_4 = Line(StartPoint=Point(0, 0, 0), EndPoint=rot3d.Geometry)

# ----
# SUN RAYS  & SHADOW
demesh_2 = DeconstructMesh(Mesh=conmesh)  # -> Vertices, Faces, Colours, Normals
pln = Plane(Plane(origin=(0, 0, 0), x=(0, 1, 0), y=(1, 0, 0)))
ln_5 = Line(StartPoint=rot3d.Geometry, EndPoint=demesh_2.Vertices)
ext = ExtendCurve(Curve=ln_5, Type=0, Start=0, End=R)
plx = LinePlane(Line=ext, Plane=pln)  # -> Point, expr("(x*2.3)", ParamL), ParamP
shatter = Shatter(Curve=ext, Parameters=plx.ParamL)
ln_6 = Line(StartPoint=rot3d.Geometry, EndPoint=plx.Point)
conmesh_3 = ConstructMesh(Vertices=plx.Point, Faces={A=0, B=1, C=2, D=3})
item_5 = ListItem(List=shatter, Index=0, Wrap=True)
move_10 = Move(Geometry=conmesh_3, Motion=Vector(0, 0, 0.01))  # -> Geometry, Transform
preview_2 = CustomPreview(
    Geometry=move_10.Geometry,
    Material={diffuse=RGB(0, 0, 0), emission=RGB(10, 10, 10), shine=0.5, specular=RGB(0, 0, 0), transparency=0})
preview_3 = CustomPreview(
    Geometry=ln_6,
    Material={diffuse=RGB(255, 215, 0), emission=RGB(10, 10, 10), shine=0.5, specular=RGB(0, 0, 0), transparency=0})
