# Grasshopper definition suns.gh (Grasshopper 1.0.7)

limit_in_degrees = Slider(45, range=45..90)
theta = Slider(1.571, range=0..10)
phi = Slider(0, range=0..10)
srf = Surface(<surface referenced from the Rhino model>)
pln = Plane(Plane(origin=(0, 0, 0), x=(0, 1, 0), y=(1, 0, 0)))
R = Slider(75, range=0..500)

# ----
# SUN POSITION W/ LIMITS
# SUN
# check if it is circle
subtraction = Subtraction(A=180, B=limit_in_degrees)
deg = Degrees(Radians=theta)
sph = Sphere(Base=PlaneXY(0, 0, 0), Radius=R)
expression = Expression(x=limit_in_degrees, y=deg, Expression="If(y<x, x, y)")
expression_2 = Expression(x=subtraction, y=expression, Expression="If(y>x, x, y)")
preview = CustomPreview(
    Geometry=sph,
    Material={diffuse=RGB(173, 216, 230), emission=RGB(180, 180, 180), shine=0.5, specular=RGB(255, 255, 255), transparency=0})
rad = Radians(Degrees=expression_2)
expression_3 = Expression(x=R, y=rad, Expression="(x*cos(y))")
expression_4 = Expression(x=R, y=rad, Expression="(x*sin(y))")
vec = VectorXYZ(XComponent=0, YComponent=expression_3, ZComponent=expression_4)  # -> Vector, Length
rot3d = Rotate3D(Geometry=vec.Vector, Angle=phi, Center=Point(0, 0, 0), Axis=Vector(0, 0, 1))  # -> Geometry, Transform
ln = Line(StartPoint=Point(0, 0, 0), EndPoint=rot3d.Geometry)

# ----
# SUN RAYS  & SHADOW
demesh = DeconstructMesh(Mesh=srf)  # -> Vertices, Faces, Colours, Normals
ln_2 = Line(StartPoint=rot3d.Geometry, EndPoint=demesh.Vertices)
ext = ExtendCurve(Curve=ln_2, Type=0, Start=0, End=R)
plx = LinePlane(Line=ext, Plane=pln)  # -> Point, expr("(x*2.3)", ParamL), ParamP
shatter = Shatter(Curve=ext, Parameters=plx.ParamL)
ln_3 = Line(StartPoint=rot3d.Geometry, EndPoint=plx.Point)
srfgrid = SurfaceFromPoints(Points=plx.Point, UCount=2, Interpolate=False)
item = ListItem(List=shatter, Index=0, Wrap=True)
preview_2 = CustomPreview(
    Geometry=ln_3,
    Material={diffuse=RGB(255, 215, 0), emission=RGB(10, 10, 10), shine=0.5, specular=RGB(0, 0, 0), transparency=0})
preview_3 = CustomPreview(
    Geometry=srfgrid,
    Material={diffuse=RGB(0, 0, 0), emission=RGB(10, 10, 10), shine=0.5, specular=RGB(0, 0, 0), transparency=0})
