# Grasshopper definition suns_v3.gh (Grasshopper 1.0.7)

phi = Slider(0, range=0..360, expression="(x*pi/180)")
theta = Slider(0, range=-90..90, expression="(x*pi/180)")
R = Slider(10, range=0..20)
R_2 = Slider(10, range=0..20)
phi_2 = Slider(184.169, range=0..360, expression="(x*pi/180)")
phi_3 = Slider(79.088, range=0..360, expression="(x*pi/180)")
phi_4 = Slider(90.125, range=0..360, expression="(x*pi/180)")
theta_2 = Slider(-82.262, range=-90..90, expression="(x*pi/180)")
phi_5 = Slider(70.227, range=0..360, expression="(x*pi/180)")
theta_3 = Slider(81.341, range=-90..90, expression="(x*pi/180)")
R_3 = Slider(10, range=0..20)
theta_4 = Slider(-65.681, range=-90..90, expression="(x*pi/180)")
R_4 = Slider(10, range=0..20)
theta_5 = Slider(-90, range=-90..90, expression="(x*pi/180)")
expression = Expression(x=R, y=theta, Expression="(x*cos(y))")
expression_2 = Expression(x=R_4, y=theta, Expression="(x*cos(y))")
expression_3 = Expression(x=R_3, y=theta, Expression="(x*cos(y))")
pt = Point(Point(0, 0, 0))
expression_4 = Expression(x=R_2, y=theta, Expression="(x*cos(y))")
expression_5 = Expression(x=R, y=theta, z=phi, Expression="(x*cos(z)*sin(y))")
expression_6 = Expression(x=R, y=theta, z=phi, Expression="(x*sin(y)*sin(z))")
expression_7 = Expression(x=R_4, y=theta, z=phi, Expression="(x*cos(z)*sin(y))")
expression_8 = Expression(x=R_4, y=theta, z=phi, Expression="(x*sin(y)*sin(z))")
expression_9 = Expression(x=R_3, y=theta, z=phi, Expression="(x*cos(z)*sin(y))")
expression_10 = Expression(x=R_3, y=theta, z=phi, Expression="(x*sin(y)*sin(z))")
expression_11 = Expression(x=R_2, y=theta, z=phi, Expression="(x*cos(z)*sin(y))")
expression_12 = Expression(x=R_2, y=theta, z=phi, Expression="(x*sin(y)*sin(z))")
move = Move(Geometry=pt, Motion=Vector(-5, -5, 0))  # -> Geometry, Transform
move_2 = Move(Geometry=pt, Motion=Vector(-5, 5, 0))  # -> Geometry, Transform
move_3 = Move(Geometry=pt, Motion=Vector(5, 5, 0))  # -> Geometry, Transform
move_4 = Move(Geometry=pt, Motion=Vector(5, -5, 0))  # -> Geometry, Transform
vec = VectorXYZ(XComponent=expression_5, YComponent=expression_6, ZComponent=expression)  # -> Vector, Length
vec_2 = VectorXYZ(XComponent=expression_7, YComponent=expression_8, ZComponent=expression_2)  # -> Vector, Length
vec_3 = VectorXYZ(XComponent=expression_9, YComponent=expression_10, ZComponent=expression_3)  # -> Vector, Length
vec_4 = VectorXYZ(XComponent=expression_11, YComponent=expression_12, ZComponent=expression_4)  # -> Vector, Length
move_5 = Move(Geometry=move.Geometry, Motion=vec.Vector)  # -> Geometry, Transform
move_6 = Move(Geometry=move_4.Geometry, Motion=vec_2.Vector)  # -> Geometry, Transform
move_7 = Move(Geometry=move_3.Geometry, Motion=vec_3.Vector)  # -> Geometry, Transform
move_8 = Move(Geometry=move_2.Geometry, Motion=vec_4.Vector)  # -> Geometry, Transform
srf4pt = _4PointSurface(CornerA=move_5.Geometry, CornerB=move_8.Geometry, CornerC=move_7.Geometry, CornerD=move_6.Geometry)  # disabled

limit_in_degrees = Slider(45, range=45..90)
theta_6 = Slider(1.571, range=0..10)
R_5 = Slider(500, range=0..500)
phi_6 = Slider(0, range=0..10)

# ----
# SUN POSITION W/ LIMITS
# SUN
# check if it is circle
subtraction = Subtraction(A=180, B=limit_in_degrees)
deg = Degrees(Radians=theta_6)
sph = Sphere(Base=PlaneXY(0, 0, 0), Radius=R_5)
expression_13 = Expression(x=limit_in_degrees, y=deg, Expression="If(y<x, x, y)")
expression_14 = Expression(x=subtraction, y=expression_13, Expression="If(y>x, x, y)")
preview = CustomPreview(
    Geometry=sph,
    Material={diffuse=RGB(173, 216, 230), emission=RGB(180, 180, 180), shine=0.5, specular=RGB(255, 255, 255), transparency=0})
rad = Radians(Degrees=expression_14)
expression_15 = Expression(x=R_5, y=rad, Expression="(x*cos(y))")
expression_16 = Expression(x=R_5, y=rad, Expression="(x*sin(y))")
vec_5 = VectorXYZ(XComponent=0, YComponent=expression_15, ZComponent=expression_16)  # -> Vector, Length
rot3d = Rotate3D(Geometry=vec_5.Vector, Angle=phi_6, Center=Point(0, 0, 0), Axis=Vector(0, 0, 1))  # -> Geometry, Transform
ln = Line(StartPoint=Point(0, 0, 0), EndPoint=rot3d.Geometry)

pln = Plane(Plane(origin=(0, 0, 0), x=(0, 1, 0), y=(1, 0, 0)))
panel = Panel("""{10,10,0}
{-10,10,0}
{-10,-10,0}
{10,-10,0}""")
conmesh = ConstructMesh(Vertices=panel, Faces={A=0, B=1, C=2, D=3})
rotax = RotateAxis(Geometry=conmesh, Angle=Slider(0, range=-3.141..3.141), Axis=Line((0, 0, 0), (0, 10, 0)))  # -> Geometry, Transform
rotax_2 = RotateAxis(Geometry=rotax.Geometry, Angle=Slider(0, range=-3.141..3.141), Axis=Line((0, 0, 0), (10, 0, 0)))  # -> Geometry, Transform
rotax_3 = RotateAxis(Geometry=rotax_2.Geometry, Angle=Slider(0, range=-3.141..3.141), Axis=Line((0, 0, 0), (0, 0, 10)))  # -> Geometry, Transform
vec_6 = VectorXYZ(XComponent=Slider(0, range=-40..40), YComponent=Slider(0, range=-40..40), ZComponent=Slider(20, range=0..50))  # -> Vector, Length
scale = Scale(Geometry=rotax_3.Geometry, Center=Point(0, 0, 0), Factor=Slider(1, range=0..2))  # -> Geometry, Transform
move_9 = Move(Geometry=scale.Geometry, Motion=vec_6.Vector)  # -> Geometry, Transform
mesh = Mesh(<mesh referenced from the Rhino model>)
panel_2 = Panel("""{10,10,0}
{-10,10,0}
{-10,-10,0}
{10,-10,0}""")
demesh = DeconstructMesh(Mesh=move_9.Geometry)  # -> Vertices, Faces, Colours, Normals
ln_2 = Line(StartPoint=panel_2, EndPoint=demesh.Vertices)
len = Length(Curve=ln_2)
len_2 = Length(Curve=ln_2)
end = EndPoints(Curve=ln_2)  # -> Start, End
panel_3 = Panel("""{10,10,0}
{-10,10,0}
{-10,-10,0}
{10,-10,0}""")
vec2pt = Vector2Pt(PointA=end.Start, PointB=end.End, Unitize=False)  # -> Vector, Length
eval = Evaluate(F="If(x>y, y, x)", x=len, y=Slider(40, range=0..100))
eval_2 = Evaluate(F="If(x>12, 12, 12)", x=len_2)
divdist = DivideDistance(Curve=ln_2, Distance=Slider(10, range=0..100))  # -> Points, Tangents, Parameters
pl = PlaneNormal(Origin=panel_3, ZAxis=vec2pt.Vector)
cyl = Cylinder(Base=pl, Radius=0.5, Length=eval)
cyl_2 = Cylinder(Base=pl, Radius=1, Length=eval_2)
item = ListItem(List=divdist.Points, Index=0, Wrap=True)
item_2 = ListItem(List=divdist.Points, Index=1, Wrap=True)
ln_3 = Line(StartPoint=item, EndPoint=item_2)
pipe = Pipe(Curve=ln_3, Radius=1, Caps=1)
divdist_2 = DivideDistance(Curve=ln_2, Distance=Slider(34, range=0..100))  # -> Points, Tangents, Parameters
pipe_2 = Pipe(Curve=ln_2, Radius=0.4, Caps=1)
item_3 = ListItem(List=divdist_2.Points, Index=0, Wrap=True)
item_4 = ListItem(List=divdist_2.Points, Index=1, Wrap=True)
ln_4 = Line(StartPoint=item_3, EndPoint=item_4)
pipe_3 = Pipe(Curve=ln_4, Radius=0.4, Caps=1)

# ----
# SUN RAYS  & SHADOW
demesh_2 = DeconstructMesh(Mesh=move_9.Geometry)  # -> Vertices, Faces, Colours, Normals
ln_5 = Line(StartPoint=rot3d.Geometry, EndPoint=demesh_2.Vertices)
ext = ExtendCurve(Curve=ln_5, Type=0, Start=0, End=R_5)
plx = LinePlane(Line=ext, Plane=pln)  # -> Point, expr("(x*2.3)", ParamL), ParamP
shatter = Shatter(Curve=ext, Parameters=plx.ParamL)
ln_6 = Line(StartPoint=rot3d.Geometry, EndPoint=plx.Point)
item_5 = ListItem(List=shatter, Index=0, Wrap=True)
preview_2 = CustomPreview(
    Geometry=ln_6,
    Material={diffuse=RGB(255, 215, 0), emission=RGB(10, 10, 10), shine=0.5, specular=RGB(0, 0, 0), transparency=0})

conmesh_2 = ConstructMesh(Vertices=plx.Point, Faces={A=0, B=1, C=2, D=3})

preview_3 = CustomPreview(
    Geometry=conmesh_2,
    Material={diffuse=RGB(0, 0, 0), emission=RGB(10, 10, 10), shine=0.5, specular=RGB(0, 0, 0), transparency=0})
